# Grasshopper definition cliffEdge.gh (Grasshopper 1.0.7)
# plug-ins: Speckle 2, Kangaroo2 Components

panel = Panel("https://speckle.xyz/streams/fd18b50cd6/objects/134aa9a63c438a68a3de5c7f7a8f6c6d")
speckleout = GetString(AtLeast=1, AtMost=1, TreeAccess=False)
specklein = GetString(panel, AtLeast=1, AtMost=1, TreeAccess=False)
sr = SynchronousReceiver(
    Stream="https://speckle.xyz/streams/fd18b50cd6/branches/main",
    AutoReceive=False,
    KitName="Objects",
    ReceivedObjectId="4450efbda929e0521cf999a5a658b77c",
    StreamWrapper="https://speckle.xyz/streams/fd18b50cd6/branches/main",
    selectedKitName="Objects")  # -> Data, Info
dso = DeconstructSpeckleObject(SpeckleObject=sr.Data, selectedKitName="Objects")
dso_2 = DeconstructSpeckleObject(SpeckleObject=dso, selectedKitName="Objects")  # -> Falloff, RegionId
dso_3 = DeconstructSpeckleObject(SpeckleObject=dso_2.Falloff, selectedKitName="Objects")
sr_2 = SynchronousReceiver(
    Stream=specklein,
    AutoReceive=False,
    KitName="Objects",
    ReceivedObjectId="134aa9a63c438a68a3de5c7f7a8f6c6d",
    StreamWrapper="https://speckle.xyz/streams/fd18b50cd6/objects/134aa9a63c438a68a3de5c7f7a8f6c6d",
    selectedKitName="Objects")  # -> Data, Info
number_slider = Slider(10000, range=0..10000)
dso_4 = DeconstructSpeckleObject(SpeckleObject=sr_2.Data, selectedKitName="Objects")  # -> Length, Mesh, RegId
mesh = Mesh(dso_4.Mesh)
mjoin = MeshJoin(Meshes=mesh)
mesh_2 = Mesh(flatten(dso_3))
number_slider_2 = Slider(1000, range=0..1000)
bbox = BoundingBox(Content=mesh_2, Plane=PlaneXY(0, 0, 0), UnionBox=True)  # -> Box, Box_2
number_slider_3 = Slider(0.02, range=0..0.1)
medges = MeshEdges(Mesh=dso_4.Mesh)  # -> NakedEdges, InteriorEdges, NonManifoldEdges
mesh_3 = Mesh(dso_4.Mesh)
one_over_x = OneOverX(Value=Slider(7059, range=0..100000))
merge = Merge(Data1=medges.NakedEdges, Data2=medges.InteriorEdges)
len = Length(Curve=dso_4.Length)
mjoin_2 = MeshJoin(Meshes=flatten(dso_4.Mesh))
len_2 = Length(Curve=merge)
multiplication = Multiplication(A=len, B=one_over_x)
avr = Average(Input=len_2)
multiplication_2 = Multiplication(A=avr, B=Slider(0.15, range=0..1))
triremesh = TriRemesh(Geometry=mesh, Sharp=True, Length=multiplication_2, Iterations=50)  # -> Triangulation, Dual, Creases
mjoin_3 = MeshJoin(Meshes=flatten(triremesh.Triangulation))  # -> flatten(Mesh)
multiplication_3 = Multiplication(A=avr, B=Slider(0.1, range=0..1))
triremesh_2 = TriRemesh(Geometry=dso_4.Mesh, Sharp=True, Length=multiplication_3, Iterations=50)  # -> Triangulation, Dual, Creases
tri = Triangulate(Mesh=mjoin_2)  # -> Mesh, Count
mjoin_4 = MeshJoin(Meshes=flatten(triremesh_2.Triangulation))
demesh = DeconstructMesh(Mesh=mjoin_3)  # -> Vertices, Faces, Colours, Normals
demesh_2 = DeconstructMesh(Mesh=mjoin_4)  # -> Vertices, Faces, Colours, Normals
number_slider_4 = Slider(25, range=0..100)
panel_2 = Panel(avr)
number_slider_5 = Slider(400, range=0..1000)
meshcp = MeshClosestPoint(Point=demesh.Vertices, Mesh=tri.Mesh)  # -> Point, Index, Parameter
number_slider_6 = Slider(1, range=0..10)
N = Count(Slider(800, range=0..1000))
meval = MeshEval(Mesh=tri.Mesh, Parameter=meshcp.Parameter)  # -> Point, Normal, Colour
conmesh = ConstructMesh(Vertices=demesh.Vertices, Faces=demesh.Faces, Colours=meval.Colour)
data = Data(conmesh)
meshcp_2 = MeshClosestPoint(Point=demesh_2.Vertices, Mesh=data)  # -> Point, Index, Parameter
meval_2 = MeshEval(Mesh=data, Parameter=meshcp_2.Parameter)  # -> Point, Normal, Colour
argb = SplitARGB(Colour=meval_2.Colour)  # -> Alpha, Red, Green, Blue
pop2d = Populate2D(Region=bbox.Box, Count=N, Seed=1)
del = DelaunayMesh(Points=pop2d, Plane=PlaneXY(0, 0, 0))
pt = ConstructPoint(XCoordinate=expr("x*10", argb.Red), YCoordinate=0, ZCoordinate=0)
series = Series(Start=0, Step=1, Count=N)
random = Random(Range=Domain(0, 2), Number=1, Seed=series, Integers=True)  # -> flatten(Random)
demesh_3 = DeconstructMesh(Mesh=del)  # -> Vertices, Faces, Colours, Normals
meshcp_3 = MeshClosestPoint(Point=meval_2.Point, Mesh=del)  # -> Point, Index, Parameter
c_script = CSharpScript(text=meshcp_3.Parameter)  # -> out, triangle, weights; inputs text: String
# ---------- c_script: C# ----------
    int startIndex = text.IndexOf("[") + 1;
    int endIndex = text.Length - 2;
    string[] substrings = text.Substring(startIndex, endIndex - startIndex + 1).Split(';');
    float[] numbers = new float[substrings.Length];

    for (int i = 0; i < numbers.Length; i++)
    {
      numbers[i] = float.Parse(substrings[i]);
    }

    triangle = int.Parse(text.Substring(0, startIndex -1));
    weights = numbers;
# ---------- end c_script ----------
round = Round(Number=multiplication)  # -> Nearest, Floor, Ceiling
face = MeshFace(demesh_3.Faces)
item = ListItem(List=meshcp_3.Parameter, Index=0, Wrap=True)
number_slider_7 = Slider(10, range=0..10)
split = SplitList(List=c_script.weights, Index=3)  # -> ListA, ListB
item_2 = ListItem(List=face, Index=c_script.triangle, Wrap=True)
panel_3 = Panel(item)
deface = DeconstructFace(Face=graft(item_2))  # -> CornerA, CornerB, CornerC, CornerD
crv = Curve([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])
crv_2 = Curve([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])
c_script_2 = CSharpScript(param=argb.Green, loops=round.Ceiling)  # -> out, A; inputs param: Double, loops: Int32
# ---------- c_script_2: C# ----------
    double realParam = param * loops;

    double iteration = Math.Floor(realParam);

    realParam -= iteration;

    realParam = realParam < 0.5 ? realParam : 0.5 - (realParam - 0.5);

    A = realParam*2;
# ---------- end c_script_2 ----------
merge_2 = Merge(Data1=deface.CornerA, Data2=deface.CornerB, Data3=deface.CornerC)
item_3 = ListItem(List=random, Index=merge_2, Wrap=True)
item_4 = ListItem(List=crv, Index=item_3, Wrap=True)
item_5 = ListItem(List=crv_2, Index=item_3, Wrap=True)
line = LineSDL(Start=pt, Direction=Vector(0, 6, 0), Length=1)  # -> graft(Line)
clx = CurveLine(Curve=item_4, Line=line)  # -> Points, Params, Count
clx_2 = CurveLine(Curve=item_5, Line=line)  # -> Points, Params, Count
pdecon = Deconstruct(Point=clx.Points)  # -> XComponent, YComponent, ZComponent
pdecon_2 = Deconstruct(Point=clx_2.Points)  # -> XComponent, YComponent, ZComponent
trim = TrimTree(Tree=split.ListA, Depth=1)
trim_2 = TrimTree(Tree=split.ListA, Depth=1)
trim_3 = TrimTree(Tree=pdecon.YComponent, Depth=1)
trim_4 = TrimTree(Tree=pdecon_2.YComponent, Depth=1)
multiplication_4 = Multiplication(A=trim_3, B=trim)
multiplication_5 = Multiplication(A=trim_4, B=trim_2)
graph = GraphMapper(c_script_2.A, x0=0, x1=1, y0=0, y1=1, container_name="Bezier", cpx=[0, 0.5362318754, 0.5652173758, 1], cpy=[0, 0, 1, 1])
ma = MassAddition(Input=multiplication_4)  # -> flatten(Result), PartialResults
ma_2 = MassAddition(Input=multiplication_5)  # -> flatten(Result), PartialResults
merge_3 = Merge(Data1=graft(ma_2.Result), Data2=graft(ma.Result))
number_slider_8 = Slider(0.234, range=0..1)
interp = InterpolateData(Data=merge_3, Parameter=graft(graph), Interpolation=2)  # -> flatten(Value)
multiplication_6 = Multiplication(A=interp, B=Slider(258, range=0..1000))
Z = UnitZ(Factor=multiplication_6)
move = Move(Geometry=meval_2.Point, Motion=Z)  # -> Geometry, Transform
conmesh_2 = ConstructMesh(Vertices=move.Geometry, Faces=demesh_2.Faces)
ss = SynchronousSender(
    Data=conmesh_2,
    Stream=speckleout,
    OutputWrappers="https://speckle.xyz\tfd18b50cd6\te0dc16b84b",
    UseDefaultCache=True,
    selectedKitName="Objects")
context_print = ContextPrint(Text=ss)
