# Grasshopper definition densify.gh (Grasshopper 1.0.7)
# plug-ins: Speckle 2, Kangaroo2 Components

panel = Panel("https://speckle.xyz/streams/fd18b50cd6/branches/reg0/densify")
panel_2 = Panel("https://speckle.xyz/streams/fd18b50cd6/objects/16e0023673b9f8936b615dc58e026116")
speckleout = GetString(panel, AtLeast=1, AtMost=1, TreeAccess=False)
specklein = GetString(panel_2, AtLeast=1, AtMost=1, TreeAccess=False)
sr = SynchronousReceiver(
    Stream=specklein,
    AutoReceive=False,
    KitName="Objects",
    ReceivedObjectId="16e0023673b9f8936b615dc58e026116",
    StreamWrapper="https://speckle.xyz/streams/fd18b50cd6/objects/16e0023673b9f8936b615dc58e026116",
    selectedKitName="Objects")  # -> Data, Info
dso = DeconstructSpeckleObject(SpeckleObject=sr.Data, selectedKitName="Objects")  # -> Falloff, RegionId
dso_2 = DeconstructSpeckleObject(SpeckleObject=dso.Falloff, selectedKitName="Objects")
triremesh = TriRemesh(Geometry=dso_2, Sharp=True, Iterations=25)  # -> Triangulation, Dual, Creases
demesh = DeconstructMesh(Mesh=dso_2)  # -> Vertices, Faces, Colours, Normals
demesh_2 = DeconstructMesh(Mesh=triremesh.Triangulation)  # -> Vertices, Faces, Colours, Normals
meshcp = MeshClosestPoint(Point=demesh_2.Vertices, Mesh=dso_2)  # -> Point, Index, Parameter
meval = MeshEval(Mesh=dso_2, Parameter=meshcp.Parameter)  # -> Point, Normal, Colour
argb = SplitARGB(Colour=meval.Colour)  # -> Alpha, Red, Green, Blue
multiplication = Multiplication(A=argb.Red, B=Slider(3000, range=0..10000))
Z = UnitZ(Factor=multiplication)
move = Move(Geometry=meval.Point, Motion=Z)  # -> Geometry, Transform
conmesh = ConstructMesh(Vertices=move.Geometry, Faces=demesh_2.Faces, Colours=meval.Colour)
ss = SynchronousSender(
    Data=conmesh,
    Stream=speckleout,
    OutputWrappers="https://speckle.xyz\tfd18b50cd6\t0dabb42bdd",
    UseDefaultCache=True,
    selectedKitName="Objects")
context_bake = ContextBake(Geometry=conmesh)
context_print = ContextPrint(Output=ss)
