# Grasshopper definition densifyDebug.gh (Grasshopper 1.0.7)
# plug-ins: Kangaroo2 Components

get_string = GetString(AtLeast=1, AtMost=1, TreeAccess=False)
mesh = Mesh(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)
triremesh = TriRemesh(Geometry=mesh, Sharp=True, Iterations=25)  # -> Triangulation, Dual, Creases
panel = Panel(get_string)
demesh = DeconstructMesh(Mesh=mesh)  # -> Vertices, Faces, Colours, Normals
demesh_2 = DeconstructMesh(Mesh=triremesh.Triangulation)  # -> Vertices, Faces, Colours, Normals
meshcp = MeshClosestPoint(Point=demesh_2.Vertices, Mesh=mesh)  # -> Point, Index, Parameter
meval = MeshEval(Mesh=mesh, Parameter=meshcp.Parameter)  # -> Point, Normal, Colour
argb = SplitARGB(Colour=meval.Colour)  # -> Alpha, Red, Green, Blue
multiplication = Multiplication(A=argb.Red, B=Slider(3, range=0..10))
Z = UnitZ(Factor=multiplication)
move = Move(Geometry=meval.Point, Motion=Z)  # -> Geometry, Transform
conmesh = ConstructMesh(Vertices=move.Geometry, Faces=demesh_2.Faces, Colours=meval.Colour)
context_bake = ContextBake(Geometry=conmesh)
