# Grasshopper definition edge types.gh (Grasshopper 1.0.7)
# plug-ins: Speckle 2, Kangaroo2 Components

panel = Panel("https://speckle.xyz/streams/fd18b50cd6/branches/reg1/coastmask")
specklein = GetString(panel, AtLeast=1, AtMost=1, TreeAccess=False)
sr = SynchronousReceiver(
    Stream=specklein,
    AutoReceive=False,
    KitName="Objects",
    ReceivedObjectId="d32d6ab0ae62c113c3ee523e54e88ba1",
    StreamWrapper="https://speckle.xyz/streams/fd18b50cd6/branches/reg1/coastmask",
    selectedKitName="Objects")  # -> Data, Info
dso = DeconstructSpeckleObject(SpeckleObject=sr.Data, selectedKitName="Objects")
dso_2 = DeconstructSpeckleObject(SpeckleObject=dso, selectedKitName="Objects")  # -> Length, Mesh, RegId
medges = MeshEdges(Mesh=dso_2.Mesh)  # -> NakedEdges, InteriorEdges, NonManifoldEdges
merge = Merge(Data1=medges.NakedEdges, Data2=medges.InteriorEdges)
len = Length(Curve=merge)
avr = Average(Input=len)
multiplication = Multiplication(A=avr, B=Slider(0.1, range=0..1))
triremesh = TriRemesh(Geometry=dso_2.Mesh, Sharp=True, Length=multiplication, Iterations=50)  # -> Triangulation, Dual, Creases
mjoin = MeshJoin(Meshes=flatten(dso_2.Mesh))
mjoin_2 = MeshJoin(Meshes=flatten(triremesh.Triangulation))
tri = Triangulate(Mesh=mjoin)  # -> Mesh, Count
demesh = DeconstructMesh(Mesh=mjoin_2)  # -> Vertices, Faces, Colours, Normals
panel_2 = Panel(avr)
meshcp = MeshClosestPoint(Point=demesh.Vertices, Mesh=tri.Mesh)  # -> Point, Index, Parameter
meval = MeshEval(Mesh=tri.Mesh, Parameter=meshcp.Parameter)  # -> Point, Normal, Colour
argb = SplitARGB(Colour=meval.Colour)  # -> Alpha, Red, Green, Blue
Z = UnitZ(Factor=argb.Red)
move = Move(Geometry=meval.Point, Motion=Z)  # -> Geometry, Transform
