# Grasshopper definition generateInner.gh (Grasshopper 1.0.7)
# plug-ins: Speckle 2, Kangaroo2 Components, Noise 4D

panel = Panel("https://speckle.xyz/streams/fd18b50cd6/objects/71e7d3470d2284ea1d6ddfae7d6371a5")
speckleout = GetString(AtLeast=1, AtMost=1, TreeAccess=False)
specklein = GetString(panel, AtLeast=1, AtMost=1, TreeAccess=False)
sr = SynchronousReceiver(
    Stream=specklein,
    AutoReceive=False,
    KitName="Objects",
    ReceivedObjectId="71e7d3470d2284ea1d6ddfae7d6371a5",
    StreamWrapper="https://speckle.xyz/streams/fd18b50cd6/objects/71e7d3470d2284ea1d6ddfae7d6371a5",
    selectedKitName="Objects")  # -> Data, Info
dso = DeconstructSpeckleObject(SpeckleObject=sr.Data, selectedKitName="Objects")  # -> Falloff, RegionId
dso_2 = DeconstructSpeckleObject(SpeckleObject=dso.Falloff, selectedKitName="Objects")
mesh = Mesh(dso_2)
medges = MeshEdges(Mesh=mesh)  # -> NakedEdges, InteriorEdges, NonManifoldEdges
merge = Merge(Data1=medges.NakedEdges, Data2=medges.InteriorEdges)
len = Length(Curve=merge)
number_slider = Slider(0.001, range=0..0.001)
number_slider_2 = Slider(0.06, range=0..1)
number_slider_3 = Slider(1e-05, range=0..1e-05)
number_slider_4 = Slider(0.02, range=0..1)
avr = Average(Input=len)
multiplication = Multiplication(A=avr, B=Slider(0.15, range=0..1))
triremesh = TriRemesh(Geometry=mesh, Target=mesh, Sharp=True, Length=multiplication, Iterations=50)  # -> Triangulation, Dual, Creases
multiplication_2 = Multiplication(A=avr, B=Slider(1e-06, range=0..1e-06))
multiplication_3 = Multiplication(A=avr, B=Slider(0, range=0..1))
demesh = DeconstructMesh(Mesh=triremesh.Triangulation)  # -> Vertices, Faces, Colours, Normals
multiplication_4 = Multiplication(A=avr, B=Slider(0, range=0..1))
simplex = SimplexNoise(Values=demesh.Vertices, Time=0, Scale=multiplication_4)
simplex_2 = SimplexNoise(Values=demesh.Vertices, Time=0, Scale=multiplication_2)
simplex_3 = SimplexNoise(Values=demesh.Vertices, Time=0, Scale=multiplication_3)
multiplication_5 = Multiplication(A=simplex, B=Slider(0.443, range=0..1))
multiplication_6 = Multiplication(A=simplex_3, B=Slider(0.119, range=0..1))
multiplication_7 = Multiplication(A=len, B=Slider(0.06314, range=0..1))
addition = Addition(A=simplex_2, B=multiplication_6, C=multiplication_5)
multiplication_8 = Multiplication(A=multiplication_7, B=addition)
Z = UnitZ(Factor=multiplication_8)
move = Move(Geometry=demesh.Vertices, Motion=Z)  # -> Geometry, Transform
conmesh = ConstructMesh(Vertices=move.Geometry, Faces=demesh.Faces)
ss = SynchronousSender(Data=conmesh, Stream=speckleout, UseDefaultCache=True, selectedKitName="Objects")
context_print = ContextPrint(Text=ss)
