# Grasshopper definition generateMountains.gh (Grasshopper 1.0.7)
# plug-ins: Speckle 2

panel = Panel("https://speckle.xyz/streams/fd18b50cd6/branches/reg4/cliffmask")
panel_2 = Panel("https://speckle.xyz/streams/fd18b50cd6/objects/16e0023673b9f8936b615dc58e026116")
speckleout = GetString(panel, AtLeast=1, AtMost=1, TreeAccess=False)
specklein = GetString(panel_2, AtLeast=1, AtMost=1, TreeAccess=False)
sr = SynchronousReceiver(
    Stream=specklein,
    AutoReceive=False,
    KitName="Objects",
    ReceivedObjectId="16e0023673b9f8936b615dc58e026116",
    StreamWrapper="https://speckle.xyz/streams/fd18b50cd6/objects/16e0023673b9f8936b615dc58e026116",
    selectedKitName="Objects")  # -> Data, Info
dso = DeconstructSpeckleObject(SpeckleObject=sr.Data, selectedKitName="Objects")  # -> Falloff, RegionId
dso_2 = DeconstructSpeckleObject(SpeckleObject=dso.Falloff, selectedKitName="Objects")
data = Data(dso_2)
demesh = DeconstructMesh(Mesh=data)  # -> Vertices, Faces, Colours, Normals
deface = DeconstructFace(Face=graft(demesh.Faces))  # -> CornerA, CornerB, CornerC, CornerD
merge = Merge(Data1=deface.CornerA, Data2=deface.CornerB, Data3=deface.CornerC)
trim = TrimTree(Tree=merge, Depth=1)
item = ListItem(List=demesh.Colours, Index=trim, Wrap=True)
argb = SplitARGB(Colour=item)  # -> Alpha, Red, Green, Blue
equals = Equality(FirstNumber=argb.Red, SecondNumber=Slider(1, range=0..1000))  # -> Equality, Inequality
partition = PartitionList(List=equals.Equality, Size=3)
ma = MassAddition(Input=partition)  # -> Result, PartialResults
larger = LargerThan(FirstNumber=ma.Result, SecondNumber=Slider(0, range=0..100))  # -> LargerThan, OrEqualTo
trim_2 = TrimTree(Tree=larger.LargerThan, Depth=1)
dispatch = Dispatch(List=demesh.Faces, DispatchPattern=trim_2)  # -> ListA, ListB
prune = PruneTree(Tree=dispatch.ListA, Minimum=1, Maximum=0)
tstat = TreeStatistics(Tree=prune)  # -> Paths, Length, Count
branch = TreeBranch(Tree=graft(data), Path=tstat.Paths, MaintainPaths=True)
demesh_2 = DeconstructMesh(Mesh=branch)  # -> Vertices, Faces, Colours, Normals
medges = MeshEdges(Mesh=branch)  # -> NakedEdges, InteriorEdges, NonManifoldEdges
conmesh = ConstructMesh(Vertices=demesh_2.Vertices, Faces=prune, Colours=demesh_2.Colours)
join = JoinCurves(Curves=medges.NakedEdges, Preserve=False)
cir = Circle(Plane=PlaneXY(0, 0, 0), Radius=1)
medges_2 = MeshEdges(Mesh=conmesh)  # -> NakedEdges, InteriorEdges, NonManifoldEdges
flip = FlipCurve(Curve=join, Guide=cir)  # -> Curve, Flag
merge_2 = Merge(Data1=medges_2.NakedEdges, Data2=medges_2.InteriorEdges)
explode = Explode(Curve=merge_2, Recursive=True)  # -> Segments, Vertices
trim_3 = TrimTree(Tree=explode.Vertices, Depth=3)
meshcp = MeshClosestPoint(Point=trim_3, Mesh=conmesh)  # -> Point, Index, Parameter
meval = MeshEval(Mesh=conmesh, Parameter=meshcp.Parameter)  # -> Point, Normal, Colour
argb_2 = SplitARGB(Colour=meval.Colour)  # -> Alpha, Red, Green, Blue
equals_2 = Equality(FirstNumber=argb_2.Red, SecondNumber=Slider(1, range=0..1000))  # -> Equality, Inequality
partition_2 = PartitionList(List=equals_2.Equality, Size=2)
ma_2 = MassAddition(Input=partition_2)  # -> Result, PartialResults
equals_3 = Equality(FirstNumber=ma_2.Result, SecondNumber=Slider(1, range=0..100))  # -> Equality, Inequality
trim_4 = TrimTree(Tree=equals_3.Equality, Depth=2)
dispatch_2 = Dispatch(List=merge_2, DispatchPattern=trim_4)  # -> ListA, ListB
eval = EvaluateCurve(Curve=dispatch_2.ListA, Parameter=0.5)  # -> Point, Tangent, Angle
alongcrv = SortAlongCurve(Points=eval.Point, Curve=flip.Curve)  # -> Points, Indices
pline = PolyLine(Vertices=alongcrv.Points, Closed=True)
explode_2 = Explode(Curve=pline, Recursive=True)  # -> Segments, Vertices
panel_3 = Panel("""0.8
0.2""")
eval_2 = EvaluateCurve(Curve=reparameterize(graft(explode_2.Segments)), Parameter=panel_3)  # -> Point, Tangent, Angle
trim_5 = TrimTree(Tree=eval_2.Point, Depth=5)
meshcp_2 = MeshClosestPoint(Point=trim_5, Mesh=conmesh)  # -> Point, Index, Parameter
partition_3 = PartitionList(List=meshcp_2.Index, Size=2)
item_2 = ListItem(List=partition_3, Index=0, Wrap=True)  # -> Item, Item1
trim_6 = TrimTree(Tree=explode_2.Segments, Depth=4)
equals_4 = Equality(FirstNumber=item_2.Item, SecondNumber=item_2.Item1)  # -> Equality, Inequality
trim_7 = TrimTree(Tree=equals_4.Equality, Depth=2)
dispatch_3 = Dispatch(List=trim_6, DispatchPattern=trim_7)  # -> ListA, ListB
data_2 = Data(dispatch_3.ListA)
join_2 = JoinCurves(Curves=data_2, Preserve=False)
end = EndPoints(Curve=join_2)  # -> Start, End
merge_3 = Merge(Data1=end.Start, Data2=end.End)
prune_2 = PruneTree(Tree=merge_3, Minimum=3, Maximum=0)
tstat_2 = TreeStatistics(Tree=prune_2)  # -> Paths, Length, Count
branch_2 = TreeBranch(Tree=conmesh, Path=tstat_2.Paths, MaintainPaths=True)
trim_8 = TrimTree(Tree=branch_2, Depth=1)
cullpt = CullDuplicates(Points=prune_2, Tolerance=0.1, CullMode=1)  # -> Points, Indices, Valence
panel_4 = Panel("""0.8
0.2""")
con = DelaunayEdges(Points=cullpt.Points, Plane=PlaneXY(0, 0, 0))  # -> Connectivity, Edges
eval_3 = EvaluateCurve(Curve=reparameterize(graft(con.Edges)), Parameter=panel_4)  # -> Point, Tangent, Angle
trim_9 = TrimTree(Tree=eval_3.Point, Depth=4)
meshcp_3 = MeshClosestPoint(Point=trim_9, Mesh=trim_8)  # -> Point, Index, Parameter
partition_4 = PartitionList(List=meshcp_3.Index, Size=2)
trim_10 = TrimTree(Tree=con.Edges, Depth=3)
item_3 = ListItem(List=partition_4, Index=0, Wrap=True)  # -> Item, Item1
equals_5 = Equality(FirstNumber=item_3.Item, SecondNumber=item_3.Item1)  # -> Equality, Inequality
explode_3 = Explode(Curve=join_2, Recursive=True)  # -> Segments, Vertices
trim_11 = TrimTree(Tree=explode_3.Segments, Depth=2)
trim_12 = TrimTree(Tree=equals_5.Equality, Depth=1)
dispatch_4 = Dispatch(List=trim_10, DispatchPattern=trim_12)  # -> ListA, ListB
merge_4 = Merge(Data1=trim_11, Data2=dispatch_4.ListA)
eval_4 = EvaluateCurve(Curve=reparameterize(merge_4), Parameter=0.5)  # -> Point, Tangent, Angle
cullpt_2 = CullDuplicates(Points=eval_4.Point, Tolerance=0.1, CullMode=1)  # -> Points, Indices, Valence
item_4 = ListItem(List=merge_4, Index=cullpt_2.Indices, Wrap=True)
join_3 = JoinCurves(Curves=item_4, Preserve=False)
eval_5 = EvaluateCurve(Curve=reparameterize(join_3), Parameter=0.5)  # -> Point, Tangent, Angle
disjoint = DisjointMesh(Mesh=conmesh)
lng = ListLength(List=disjoint)
pull = PullPoint(Point=eval_5.Point, Geometry=graft(disjoint), ClosestOnly=True)  # -> ClosestPoint, Distance
series = Series(Start=0, Step=1, Count=lng)
sort = SortList(Keys=pull.Distance, ValuesA=series)  # -> Keys, ValuesA
item_5 = ListItem(List=sort.ValuesA, Index=0, Wrap=True)
trim_13 = TrimTree(Tree=item_5, Depth=1)
item_6 = ListItem(List=disjoint, Index=trim_13, Wrap=True)
medges_3 = MeshEdges(Mesh=item_6)  # -> NakedEdges, InteriorEdges, NonManifoldEdges
merge_5 = Merge(Data1=medges_3.NakedEdges, Data2=medges_3.InteriorEdges)
eval_6 = EvaluateCurve(Curve=merge_5, Parameter=0.5)  # -> Point, Tangent, Angle
pull_2 = PullPoint(Point=eval_6.Point, Geometry=join_3, ClosestOnly=True)  # -> ClosestPoint, Distance
larger_2 = LargerThan(FirstNumber=pull_2.Distance, SecondNumber=Slider(0, range=0..100))  # -> LargerThan, OrEqualTo
dispatch_5 = Dispatch(List=merge_5, DispatchPattern=larger_2.LargerThan)  # -> ListA, ListB
eval_7 = EvaluateCurve(Curve=dispatch_5.ListB, Parameter=0.5)  # -> Point, Tangent, Angle
alongcrv_2 = SortAlongCurve(Points=eval_7.Point, Curve=graft(join_3))  # -> Points, Indices
item_7 = ListItem(List=dispatch_5.ListB, Index=alongcrv_2.Indices, Wrap=True)
panel_5 = Panel("""0.05
0.95""")
item_8 = ListItem(List=eval_7.Point, Index=alongcrv_2.Indices, Wrap=True)
crv_cp = CurveClosestPoint(Point=item_8, Curve=reparameterize(graft(join_3)))  # -> Point, Parameter, Distance
end_2 = EndPoints(Curve=item_7)  # -> Start, End
eval_8 = EvaluateCurve(Curve=reparameterize(graft(item_7)), Parameter=panel_5)  # -> Point, Tangent, Angle
side = CurveSide(Curve=graft(join_3), Point=end_2.Start)  # -> Side, Left, Right
pline_2 = PolyLine(Vertices=reverse(eval_8.Point), Closed=False)
pline_3 = PolyLine(Vertices=eval_8.Point, Closed=False)
trim_14 = TrimTree(Tree=pline_3, Depth=1)
trim_15 = TrimTree(Tree=pline_2, Depth=1)
cls = Closed(Curve=join_3)  # -> Closed, Periodic
p_n_c = PickNChoose(Pattern=side.Left, Stream0=trim_15, Stream1=trim_14)
item_9 = ListItem(List=p_n_c, Index=0, Wrap=True)  # -> Item1, Item
p_n_c_2 = PickNChoose(Pattern=cls.Closed, Stream1=item_9.Item1)
merge_6 = Merge(Data1=p_n_c_2, Data2=p_n_c)
clean = CleanTree(RemoveNulls=True, RemoveInvalid=True, RemoveEmpty=False, Tree=merge_6)
long = LongestList(ListA=clean, ListB=Slider(0, range=0..100), PaddingMode=2)  # -> ListA, ListB
long_2 = LongestList(ListA=clean, ListB=Slider(1, range=0..100), PaddingMode=2)  # -> ListA, ListB
frgb = ColourRGBF(Alpha=1, Red=long_2.ListB, Green=crv_cp.Parameter, Blue=0)
frgb_2 = ColourRGBF(Alpha=1, Red=long.ListB, Green=crv_cp.Parameter, Blue=0)
explode_4 = Explode(Curve=clean, Recursive=True)  # -> Segments, Vertices
weave = Weave(Pattern=[0, 1], Stream0=frgb_2, Stream1=frgb, NullGaps=False)
number_slider = Slider(10, range=0..10)
number_slider_2 = Slider(13, range=0..100)
trim_16 = TrimTree(Tree=explode_4.Vertices, Depth=1)
lng_2 = ListLength(List=trim_16)
data_3 = Data(dso.RegionId)
series_2 = Series(Start=0, Step=2, Count=expr("(x*0.5)-1", lng_2))
addition = Addition(A=series_2, B=Slider(1, range=0..10))
addition_2 = Addition(A=series_2, B=Slider(2, range=0..10))
addition_3 = Addition(A=series_2, B=Slider(3, range=0..10))
quad = MeshQuad(CornerA=series_2, CornerB=addition, CornerC=addition_3, CornerD=addition_2)
conmesh_2 = ConstructMesh(Vertices=trim_16, Faces=quad, Colours=weave)
cso = CreateSpeckleObject(RegId=data_3, Length=join_3, Mesh=conmesh_2, selectedKitName="Objects")  # -> flatten(SpeckleObject)
panel_6 = Panel(quad)
cso_2 = CreateSpeckleObject(Cliffs=cso, selectedKitName="Objects")
ss = SynchronousSender(
    Data=cso_2,
    Stream=speckleout,
    OutputWrappers="https://speckle.xyz\tfd18b50cd6\t05d573f63b",
    UseDefaultCache=True,
    selectedKitName="Objects")
context_print = ContextPrint(Output=ss)
